# Grasshopper definition grid_checker.gh (Grasshopper 1.0.8)
# Copyright: Arup
# plug-ins: RhinoCodePluginGH

py3 = Python3Script(model_id="00255")  # -> out, path
# ---------- py3: Python ----------
path = fr"\\global\EastAsia\HKG\Group\GEO\Specialism\Engineering Geology\AI\01 LSDyna Surrogate\Data\problem_data_rerun\{model_id}\02_extract\{model_id}_nodes.csv"
# ---------- end py3 ----------
path = FilePath(py3.path)
panel = Panel(path)
py3_2 = Python3Script(csv_path=path, rounding_precision="1")  # -> out, gh_points; inputs rounding_precision: Int32
# ---------- py3_2: Python ----------
import csv
import rhinoscriptsyntax as rs
import scriptcontext as sc
import Rhino.Geometry as rg

def read_and_plot_csv(csv_path, x_col_name, y_col_name, rounding_precision):
    points = []  # List to hold the Rhino points

    # Read the CSV file
    with open(csv_path, 'r') as csvfile:
        reader = csv.DictReader(csvfile)
        
        # Iterate over each row in the CSV
        for row in reader:
            # Extract and round the x and y values
            x = round(float(row[x_col_name]), rounding_precision)
            y = round(float(row[y_col_name]), rounding_precision)
            
            # Create a point at the x, y coordinates
            point = rg.Point3d(x, y, 0)  # Assuming all points lie on the XY plane (z = 0)
            
            # Add the point to our list
            points.append(point)

    # Now that we have all points, we can output them to Grasshopper
    return points

# Example usage within a Grasshopper Python component:
# Provide your own CSV path and column names here
csv_path = csv_path
x_col_name = "Node_X"
y_col_name = "Node_Y"
rounding_precision = rounding_precision  # The number of decimal places to round to

# Call the function and set the output
gh_points = read_and_plot_csv(csv_path, x_col_name, y_col_name, rounding_precision)

# The variable gh_points can be used as an output parameter in a Grasshopper Python script component
# To see the points in Grasshopper, right-click on the output handle of this Python component and choose 'Set one Point'.
# ---------- end py3_2 ----------
py3_3 = Python3Script(csv_path=path)  # -> out, gh_points
# ---------- py3_3: Python ----------
import csv
import rhinoscriptsyntax as rs
import scriptcontext as sc
import Rhino.Geometry as rg

def read_and_plot_csv(csv_path, x_col_name, y_col_name, z_col_name):
    points = []  # List to hold the Rhino points

    # Read the CSV file
    with open(csv_path, 'r') as csvfile:
        reader = csv.DictReader(csvfile)
        
        # Iterate over each row in the CSV
        for row in reader:
            # Extract the x and y values without rounding
            x = float(row[x_col_name])
            y = float(row[y_col_name])
            z = float(row[z_col_name])
            
            # Create a point at the x, y coordinates
            point = rg.Point3d(x, y, z)  # Assuming all points lie on the XY plane (z = 0)
            
            # Add the point to our list
            points.append(point)

    # Now that we have all points, we can output them to Grasshopper
    return points

# Example usage within a Grasshopper Python component:
# Provide your own CSV path and column names here
  # Update this path with your CSV file location
x_col_name = "Node_X"
y_col_name = "Node_Y"
z_col_name = "Node_Z"

# Call the function and set the output
gh_points = read_and_plot_csv(csv_path, x_col_name, y_col_name, z_col_name)

# The variable gh_points can be used as an output parameter in a Grasshopper Python script component
# To see the points in Grasshopper, right-click on the output handle of this Python component and choose 'Set one Point'.
# ---------- end py3_3 ----------
