# Grasshopper definition visualiser.gh (Grasshopper 1.0.7)
# Copyright: Arup
# plug-ins: HFTidyCanvas

path = FilePath("C:\Users\thomas.bush\Documents\temp\lsdyna-test\data\SB01-SF01_OHL_60s_3mGrid_TS0\RAW_DATA\SB01-SF01_OHL_60s_3mGrid_TS0_shells.csv")
path_2 = FilePath("C:\Users\thomas.bush\Documents\temp\lsdyna-test\data\SB01-SF01_OHL_60s_3mGrid_TS0\RAW_DATA\SB01-SF01_OHL_60s_3mGrid_TS0_nodes.csv")
file = ReadFile(File=path, PerLineParse=True)
file_2 = ReadFile(File=path_2, PerLineParse=True)
split = SplitList(List=file, Index="1")  # -> ListA, ListB
split_2 = SplitList(List=file_2, Index="1")  # -> ListA, ListB
split_3 = TextSplit(Text=split.ListB, Separators=",")
split_4 = TextSplit(Text=split_2.ListB, Separators=",")
split_5 = TextSplit(Text=split_2.ListA, Separators=",")
item = ListItem(List=simplify(split_3), Index=0, Wrap=True)  # -> Item, Item1, Item2, Item3, Item4, Item5, Item6
split_6 = TextSplit(Text=split.ListA, Separators=",")
item_2 = ListItem(List=simplify(split_4), Index=0, Wrap=True)  # -> Item, Item1, Item2, Item3, Item4, Item5
panel = Panel(split_5)
panel_2 = Panel(split_6)
merge = Merge(Data1=item.Item3, Data2=item.Item4, Data3=item.Item5, Data4=item.Item6)
pt = ConstructPoint(XCoordinate=item_2.Item2, YCoordinate=item_2.Item3, ZCoordinate=item_2.Item4)
flatten = FlattenTree(Tree=merge, Path="{0}")
cset = CreateSet(List=flatten)  # -> Set, Map
preview = CustomPreview(Geometry=pt, Material=ColourSwatch(SwatchColor=RGB(255, 255, 255)))
panel_3 = Panel(cset.Set)
panel_4 = Panel(item_2.Item1)
cull = CullPattern(List=pt, CullPattern=[False, False, True, True])
tmatch = MatchText(Text=panel_3, Pattern=panel_4, Case=True)
ma = MassAddition(Input=tmatch)  # -> Result, PartialResults
cull_2 = CullPattern(List=pt, CullPattern=ma.Result)
list = DataDescription(cull_2)
